# Grasshopper definition curve_info.gh (Grasshopper 1.0.7)

pt = ConstructPoint(XCoordinate=0, YCoordinate=0, ZCoordinate=0)
# Considerações:
# 
# 1 - o comprimento de uma curva qualquer sempre será um números inteiros não negativos;
# 
# 2 - Quando dividimos um número inteiro por 2, o resto obtido só pode ser 0 ou 1.
# 
# 3 - Quando dividimos um número inteiro por 2, o resto obtido só pode ser 0 ou 1.
pt_2 = ConstructPoint(XCoordinate=0, YCoordinate=Slider(15, range=0..100), ZCoordinate=0)
ln = Line(StartPoint=pt, EndPoint=pt_2)
crv = Curve(ln)
python = GhPythonScript(curve=crv)  # -> out, a; inputs curve: Curve
# ---------- python: Python ----------
__author__ = "Renato Godoi da Cruz"
__version__ = "2021.02.12"

import rhinoscriptsyntax as rs

print("Este componente mostra informações de uma curva")
print("-----")

# Determina o comprimento da curva
len = rs.CurveLength(curve)

# Esta curva tem comprimento Inteiro ou não?
print(type(len))

## se for int, é positivo ou negativo?



# Meio (divisão por 2)




# Critérios de divisibilidade
"""
Os critérios de divisibilidade são constituídos por regras práticas que nos 
possibilitam dizer se um determinado número natural é ou não divisível por 
outro número natural, sem que seja preciso efetuar essa divisão.
"""

## Divisibilidade por 2
"""
Um número natural é divisível por 2 quando é par
"""

## Divisibilidade por 3
"""
Um número natural é divisível por 3 quando a soma de todos os seus algarismos
forma um número divisível por 3, ou seja, um múltiplo de 3
"""

## Divisibilidade por 4
"""
Um número natural é divisível por 4 quando seus dois últimos algarismos são 00
ou formam outro número natural que é divisível por 4.
"""

## Divisibilidade por 5
"""
Um número natural é divisível por 5 quando termina em 0 ou 5.
"""

## Divisibilidade por 6
"""
Um número natural é divisível por 6 quando é divisível por 2 (número par) e
por 3, simultaneamente
"""

## Divisibilidade por 7
"""
Um número natural é divisível por 7 quando a diferença entre as suas dezenas e o
dobro do valor do seu algarismo das unidades é divisível por 7.
"""

## Divisibilidade por 8
"""
Um número natural é divisível por 8 quando seus três últimos algarismos forem
000 ou esses três últimos algarismos formarem um número também divisível por 8.
"""

## Divisibilidade por 9
"""
Um número natural é divisível por 9 quando a soma de todos os seus algarismos
formam um número que é divisível por 9.
"""

## Divisibilidade por 10
"""
Um número natural é divisível por 10 se for divisível por 2 (número par) e também
por 5, simultaneamente. Assim sendo, um número divisível por 10 termina
obrigatoriamente em 0 (algarismo das unidades é 0).
"""

## Divisibilidade por 11
"""
Um número natural é divisível por 11 quando o valor absoluto entre a diferença
da soma dos algarismos de ordem ímpar para a soma dos algarismos de ordem par for
0 ou um número divisível por 11.
"""

## Divisibilidade por 12
"""
Um número natural é divisível por 12 quando for divisível por 3 e 4, simultaneamente.
"""

## Divisibilidade por 13
"""
Um número natural é divisível por 13 quando a soma da sua quantidade de dezenas
com o quádruplo do valor do seu algarismo das unidades dá origem a um número
divisível por 13.
"""

## Divisibilidade por 14
"""
Um número natural é divisível por 14 quando for divisível por 2 (número par)
e por 7, simultaneamente.
"""

## Divisibilidade por 15
"""
Um número natural é divisível por 15 quando for divisível por 3 e por 5, simultaneamente.
Assim sendo, um número divisível por 15 termina obrigatoriamente em
0 (algarismo das unidades é 0) ou 5 (algarismo das unidades é 5).
"""
# ---------- end python ----------
len = Length(Curve=crv)
panel = Panel(len)
panel_2 = Panel(python.out)
