# Grasshopper definition 02_exploded_box.gh (Grasshopper 0.9.76)
# plug-ins: Python Interpreter

pt = ConstructPoint(XCoordinate=10, YCoordinate=10, ZCoordinate=10)
pt_2 = ConstructPoint(XCoordinate=0, YCoordinate=0, ZCoordinate=0)
number_slider = Slider(5.19, range=0..10)
box = Box2Pt(PointA=pt_2, PointB=pt, Plane=PlaneXY(0, 0, 0))
box_2 = Box(box)

c_script = CSharpScript(box=box_2, dis=number_slider)  # -> out, A; inputs box: Brep, dis: Double
# ---------- c_script: C# ----------
    //get the brep center
    Rhino.Geometry.AreaMassProperties area = Rhino.Geometry.AreaMassProperties.Compute(box);
    Point3d box_center = area.Centroid;

    //get a list of faces
    Rhino.Geometry.Collections.BrepFaceList faces = box.Faces;

    //decalre variables
    Point3d center;
    Vector3d dir;
    List<Rhino.Geometry.Brep> exploded_faces = new List<Rhino.Geometry.Brep>();

    //loop through all faces
    for( int i = 0; i < faces.Count(); i++ )
    {
      //extract each of the face
      Rhino.Geometry.Brep extracted_face = box.Faces.ExtractFace(i);

      //get the center of each face
      area = Rhino.Geometry.AreaMassProperties.Compute(extracted_face);
      center = area.Centroid;

      //calculate move direction (from box centroid to face center)
      dir = center - box_center;
      dir.Unitize();
      dir *= dis;

      //move the extracted face
      extracted_face.Transform(Transform.Translation(dir));

      //add to exploded_faces list
      exploded_faces.Add(extracted_face);
    }

    //assign exploded list of faces to output
    A = exploded_faces;
# ---------- end c_script ----------
panel = Panel(c_script.A)

python = PythonScript(box=box_2, dis=number_slider)  # -> out, a; inputs box: Brep
# ---------- python: Python ----------
import Rhino

#get the brep center
area = Rhino.Geometry.AreaMassProperties.Compute(box)
box_center = area.Centroid

#get a list of faces
faces = box.Faces

#decalre variables
exploded_faces = []

#loop through all faces
for i, face in enumerate(faces):
    
    #get a duplicate of the face
    extracted_face = faces.ExtractFace(i)
    
    #get the center of each face
    area = Rhino.Geometry.AreaMassProperties.Compute(extracted_face)
    center = area.Centroid
    
    #calculate move direction (from box centroid to face center)
    dir = center - box_center
    dir.Unitize()
    dir *= dis
    
    #move the extracted face
    move = Rhino.Geometry.Transform.Translation(dir)
    extracted_face.Transform(move)
    
    #add to exploded_faces list
    exploded_faces.append(extracted_face)
 
#assign exploded list of faces to output
a = exploded_faces
# ---------- end python ----------
panel_2 = Panel(python.a)
