# Grasshopper definition 03_tangent_spheres.gh (Grasshopper 0.9.76)
# plug-ins: Python Interpreter

number_slider = Slider(0.67, range=0..1)
pt = ConstructPoint(XCoordinate=0, YCoordinate=0, ZCoordinate=0)
pt_2 = ConstructPoint(XCoordinate=18, YCoordinate=8, ZCoordinate=0)
expression = Expression(A=pt, B=pt_2, t=number_slider, Expression="A + t * (B - A)")
expression_2 = Expression(A=pt, D=expression, t=number_slider, Expression="A + 0.5 * (D - A)")
expression_3 = Expression(D=expression, B=pt_2, t=number_slider, Expression="D + 0.5 * (B - D)")
dist = Distance(PointA=pt, PointB=expression_2)
dist_2 = Distance(PointA=expression_3, PointB=pt_2)
python = PythonScript(A=pt, B=pt_2, t=number_slider)  # -> out, s1, s2; inputs A: Point3d, B: Point3d
# ---------- python: Python ----------
import Rhino as rc

#find a point between A and B
D = A + t * (B - A)

#find mid point between A and B
C1 = A + 0.5 * (D - A)

#find mid point between D and B
C2 = D + 0.5 * (B - D)

#find spheres radius
r1 = A.DistanceTo(C1) #C1 - A
r2 = B.DistanceTo(C2)

#create spheres and assing to output
s1 = rc.Geometry.Sphere(C1, r1)
s2 = rc.Geometry.Sphere(C2, r2)

print r1
# ---------- end python ----------
pl = PlaneNormal(Origin=[expression_2, expression_3], ZAxis=Vector(0, 0, 1))
c_script = CSharpScript(A=pt, B=pt_2, t=number_slider)  # -> out, S1, S2; inputs A: Point3d, B: Point3d, t: Double
# ---------- c_script: C# ----------
    //declare variable
    Rhino.Geometry.Point3d D, C1, C2;
    double r1, r2;

    //find a point between A and B
    D = A + t * (B - A);

    //find mid point between A and B
    C1 = A + 0.5 * (D - A);

    //find mid point between D and B
    C2 = D + 0.5 * (B - D);

    //find spherer radius
    r1 = A.DistanceTo(C1);
    r2 = B.DistanceTo(C2);

    //create spheres and assing to output
    S1 = new Rhino.Geometry.Sphere(C1, r1);
    S2 = new Rhino.Geometry.Sphere(C2, r2);
# ---------- end c_script ----------
sph = Sphere(Base=pl, Radius=[dist, dist_2])
