# Grasshopper definition unnamed.gh (Grasshopper 0.9.76)

number_slider = Slider(-5, range=-10..-4)
number_slider_2 = Slider(14, range=0..20)
pt = ConstructPoint(XCoordinate=0, YCoordinate=0, ZCoordinate=0)
pt_2 = ConstructPoint(XCoordinate=number_slider, YCoordinate=0, ZCoordinate=0)
pt_3 = ConstructPoint(XCoordinate=number_slider, YCoordinate=number_slider_2, ZCoordinate=0)
pt_4 = ConstructPoint(XCoordinate=0, YCoordinate=number_slider_2, ZCoordinate=0)
nurbs = NurbsCurve(Vertices=[pt, pt_2, pt_3, pt_4], Degree=3, Periodic=False)  # -> Curve, Length, Domain
Z = UnitZ(Factor=Slider(10, range=0..10))
extr = Extrude(Base=nurbs.Curve, Direction=Z)
