# Grasshopper definition vector_math.gh (Grasshopper 0.9.76)
# plug-ins: Python Interpreter

number_slider = Slider(-5, range=-10..-4)
number_slider_2 = Slider(10, range=0..10)
number_slider_3 = Slider(14, range=0..20)
pt = ConstructPoint(XCoordinate=0, YCoordinate=0, ZCoordinate=0)
pt_2 = ConstructPoint(XCoordinate=number_slider, YCoordinate=0, ZCoordinate=0)
pt_3 = ConstructPoint(XCoordinate=number_slider, YCoordinate=number_slider_3, ZCoordinate=0)
pt_4 = ConstructPoint(XCoordinate=0, YCoordinate=number_slider_3, ZCoordinate=0)
nurbs = NurbsCurve(Vertices=[pt, pt_2, pt_3, pt_4], Degree=3, Periodic=False)  # -> Curve, Length, Domain
Z = UnitZ(Factor=number_slider_2)
division = Division(A=number_slider_3, B=2)
division_2 = Division(A=number_slider_2, B=2)
extr = Extrude(Base=nurbs.Curve, Direction=Z)
pt_5 = ConstructPoint(XCoordinate=division, YCoordinate=division, ZCoordinate=division_2)

python = PythonScript(pt=pt_5, srf=extr)  # -> out, a
# ---------- python: Python ----------
#import RhinoScript Library
import rhinoscriptsyntax as rs

#find the closest point
u, v = rs.SurfaceClosestPoint(srf, pt)

#get closest point
closest_pt = rs.EvaluateSurface(srf, u, v)

#calculate direction from closest point to test point
dir = rs.PointCoordinates(pt) - closest_pt

#calculate surface normal
normal = rs.SurfaceNormal(srf, [u, v])

#compare the two directions using the dot product
a = dir * normal
# ---------- end python ----------
point_behind_surface = Panel(python.a)

c_script = CSharpScript(pt=pt_5, srf=extr)  # -> out, A; inputs pt: Point3d, srf: Surface
# ---------- c_script: C# ----------
    //Declare variable
    double u, v;
    Point3d closest_pt;

    //get closest point u, v
    srf.ClosestPoint(pt, out u, out v);

    //get closest point
    closest_pt = srf.PointAt(u, v);

    // calculate direction from closest point to test point
    Vector3d dir = pt - closest_pt;

    // calculate surface normal
    Vector3d normal = srf.NormalAt(u, v);

    // compare the two directions using the dot product
    A = dir * normal;
# ---------- end c_script ----------
point_behind_surface_2 = Panel(c_script.A)
